% Requirement links of ZEPS_Architecture.slx (R2020b)

block :56 implements ZEPS_Requirements.slreqx#9: Water Pollution
block :56 implements ZEPS_Requirements.slreqx#10: Fresh Water
block :57 implements ZEPS_Requirements.slreqx#7: C02 Emission
block :57 implements ZEPS_Requirements.slreqx#15: Electrical Engines
block :57 implements ZEPS_Requirements.slreqx#18: Engine Power
block :63 implements ZEPS_Requirements.slreqx#16: Fuel Cells
block :63 implements ZEPS_Requirements.slreqx#19: Engine duty
block :63 implements ZEPS_Requirements.slreqx#11: Self sustainable
block :64 implements ZEPS_Requirements.slreqx#17: Backup Battery
block :64 implements ZEPS_Requirements.slreqx#13: Energy storage
block :64 implements ZEPS_Requirements.slreqx#12: Solar Power
block :65 implements ZEPS_Requirements.slreqx#12: Solar Power
block :66 implements ZEPS_Requirements.slreqx#13: Energy storage
block :66 implements ZEPS_Requirements.slreqx#19: Engine duty
block :88 implements ZEPS_Requirements.slreqx#7: C02 Emission
block :88 implements ZEPS_Requirements.slreqx#15: Electrical Engines
block :88 implements ZEPS_Requirements.slreqx#18: Engine Power
block :90 implements ZEPS_Requirements.slreqx#9: Water Pollution
block :90 implements ZEPS_Requirements.slreqx#10: Fresh Water