# Requirement set ZEPS_Requirements (R2020b)

## 1 [#8] Environment (Container)

### 1.1 [#7] C02 Emission
The ship shall produce zero emission

### 1.2 [#9] Water Pollution
The ship shall recycle sewage to minimize the water pollution to the river

### 1.3 [#10] Fresh Water
The ship shall convert water from the river to drinable water using a water purification system together with a tank for one day

## 2 [#11] Self sustainable (Container)

### 2.1 [#12] Solar Power
The ship shall have solar panels to generate power

### 2.2 [#13] Energy storage
The ship shall have an Energy storage for cruises over a maximum of two weeks

## 3 [#14] Electrical (Container)

### 3.1 [#15] Electrical Engines
The ship shall have electrical engines to enable zero emission propulsion

### 3.2 [#16] Fuel Cells
The ship shall have fuel cells with a H2 tank to provide the main electrical energy

### 3.3 [#17] Backup Battery
The ship shall have a second electrical storage for peak loads

### 3.4 [#18] Engine Power
The electrical engine power shall be similar / slighlty smaller than the power of the installed diesel engines

### 3.5 [#19] Engine duty
The ship shall be able to take trips under full engine power up to 10 hours